# Grasshopper definition 12344.gh (Grasshopper 1.0.7)
# plug-ins: PTComponentLibrary

surface = Surface(<surface referenced from the Rhino model>)
surface_2 = Surface([<surface referenced from the Rhino model> x14])
deconstruct_brep = DeconstructBrep(Brep=surface_2)  # -> Faces, flatten(Edges), Vertices
deconstruct_brep_2 = DeconstructBrep(Brep=surface)  # -> Faces, flatten(Edges), Vertices
number_slider = Slider(1, range=0..10)
surface_3 = Surface(surface_2)
curve = Curve(deconstruct_brep.Edges)
curve_2 = Curve(deconstruct_brep_2.Edges)
divide_distance = DivideDistance(Curve=curve, Distance=Slider(2, range=0..10), AddEnd=True)
negative = Negative(Value=Slider(0.5, range=0..1))
area = Area(Geometry=surface_3)  # -> flatten(Area), flatten(Centroid)
offset_curve = OffsetCurve(Curve=surface, Distance=negative, Corners=1)
populate_2d = Populate2D(Region=offset_curve, Count=Slider(357, range=10..1000), Seed=Slider(580, range=0..1000))
divide_distance_2 = DivideDistance(Curve=offset_curve, Distance=Slider(2, range=0..10), AddEnd=True)
delaunay_edges = DelaunayEdges(Points=flatten([populate_2d, divide_distance_2, area.Centroid, divide_distance]), Plane=PlaneXY(0, 0, 0))  # -> Connectivity, Edges
curve_3 = Curve(delaunay_edges.Edges)
